# Grasshopper definition GSA Model Generation.gh (Grasshopper 1.0.8)
# plug-ins: GSA

series = Series(Start=0, Step=1, Count=10)
series_2 = Series(Start=0, Step=1, Count=10)
xz = XZPlane(Origin=Point(0, 0, 0))
pt = ConstructPoint(XCoordinate=series, YCoordinate=0, ZCoordinate=0)
pt_2 = ConstructPoint(XCoordinate=series_2, YCoordinate=0, ZCoordinate=0)
xz_2 = XZPlane(Origin=Point(0, 0, 0))
rectangle = Rectangle(Plane=PlaneXY(0, 0, 0), XSize="-5 to 5", YSize="-5 to 5", Radius=0)  # -> Rectangle, Length
rectangle_2 = Rectangle(Plane=xz, XSize="-5 to 5", YSize="-5 to 5", Radius=0)  # -> Rectangle, Length
yz = YZPlane(Origin=pt)
yz_2 = YZPlane(Origin=pt_2)
rectangle_3 = Rectangle(Plane=xz_2, XSize="-5 to 5", YSize="-5 to 5", Radius=0)  # -> Rectangle, Length
panel = Panel("25")
rectangle_4 = Rectangle(Plane=PlaneXY(0, 0, 0), XSize="-100 to 100", YSize="-100 to 100", Radius=0)  # -> Rectangle, Length
cir = Circle(Plane=yz, Radius="5")
cir_2 = Circle(Plane=yz_2, Radius="5")
mesh_uv = MeshSurface(Surface=rectangle.Rectangle, UCount="50", VCount="50", Overhang=True, Equalize=False)
mesh_uv_2 = MeshSurface(Surface=rectangle_2.Rectangle, UCount="50", VCount="50", Overhang=True, Equalize=False)
split = SplitWithBrep(Curve=cir_2, Brep=rectangle_4.Rectangle)  # -> Curve, Points
mesh_uv_3 = MeshSurface(Surface=rectangle_3.Rectangle, UCount="50", VCount="50", Overhang=True, Equalize=False)
msphereex = MeshSphereEx(Base=PlaneXY(0, 0, 0), Radius="5", Count="30")
item = ListItem(List=split.Curve, Index=0, Wrap=True)  # -> flatten(Item)
md_slider = MDSlider(
    SliderMode=0,
    slider_value=Point(0.4565891173, 1, 0.5),
    x_domain=Domain(0, 1),
    y_domain=Domain(0.5, 1),
    z_domain=Domain(0, 1))
xy = XYPlane(Origin=Point(0, 0, 0))
md_slider_2 = MDSlider(
    SliderMode=0,
    slider_value=Point(0.4992720441, 0.500380865, 0.5),
    x_domain=Domain(0, 1),
    y_domain=Domain(0, 1),
    z_domain=Domain(0, 1))
sph = Sphere(Base=PlaneXY(0, 0, 0), Radius="5")
medges = MeshEdges(Mesh=mesh_uv_2)  # -> NakedEdges, InteriorEdges, NonManifoldEdges
loft = Loft(Curves=item, Options={Adjust=False, Closed=False, LoftEnds=0, LoftSimp=0, LoftType=0, Rebuild=10, Refit=0.01})
msplit = MeshSplitPlane(Mesh=msphereex, Plane=xy)  # -> Above, Below
join = JoinCurves(Curves=medges.NakedEdges, Preserve=False)
quad = Quadrangulate(Mesh=msplit.Above, Angle=0.03490658504, Ratio=0.875)  # -> Mesh, Count
splitatcorners = SplitAtCorners(Poly=join, Angle=Slider(0.785, range=0..1))  # -> Corners, Parts
mesh_uv_4 = MeshSurface(Surface=loft, UCount="50", VCount="50", Overhang=True, Equalize=False)
evalsrf = EvaluateSurface(Surface=reparameterize(sph), Point=md_slider)  # -> Point, Normal, UDirection, VDirection, Frame
evalsrf_2 = EvaluateSurface(Surface=reparameterize(loft), Point=md_slider_2)  # -> Point, Normal, UDirection, VDirection, Frame
clean = CombineClean(Meshes=quad.Mesh)
item_2 = ListItem(List=splitatcorners.Parts, Index=2, Wrap=True)
mat = CreateMaterial(Material_type="Steel", Design_Code="EN 1993-1-1:2005", Grade="S355")
mat_2 = CreateMaterial(Material_type="Steel", Design_Code="EN 1993-1-1:2005", Grade="S355")
mesh = Mesh(clean)
demesh = DeconstructMesh(Mesh=mesh)  # -> Vertices, Faces, Colours, Normals
number_slider = Slider(5, range=0..10)
demesh_2 = DeconstructMesh(Mesh=mesh_uv_4)  # -> Vertices, Faces, Colours, Normals
mat_3 = CreateMaterial(Material_type="Steel", Design_Code="EN 1993-1-1:2005", Grade="S355")
explode = Explode(Curve=item_2, Recursive=True)  # -> Segments, Vertices
lng = ListLength(List=demesh.Vertices)
explode_2 = Explode(Curve=rectangle.Rectangle, Recursive=True)  # -> Segments, Vertices
cp = ClosestPoint(Point=evalsrf_2.Point, Cloud=demesh_2.Vertices)  # -> ClosestPoint, CPIndex, Distance
explode_3 = Explode(Curve=rectangle_3.Rectangle, Recursive=True)  # -> Segments, Vertices
subtraction = Subtraction(A=lng, B=number_slider)
duppt = RemoveDuplicatePts(Points=explode_2.Vertices, Tolerance=0.01)
duppt_2 = RemoveDuplicatePts(Points=explode.Vertices, Tolerance=0.01)
prop2d = Create2DProperty(Thickness_cm="2", Material=mat, Type="Shell", Unit="cm")
cps = ClosestPoints(Point=evalsrf.Point, Cloud=demesh.Vertices, Count=number_slider)  # -> ClosestPoint, CPIndex, Distance
item_3 = ListItem(List=splitatcorners.Parts, Index=0, Wrap=True)
cps_2 = ClosestPoints(Point=evalsrf_2.Point, Cloud=demesh_2.Vertices, Count=Slider(5, range=0..10))  # -> ClosestPoint, CPIndex, Distance
prop2d_2 = Create2DProperty(Thickness_cm="2", Material=mat_2, Type="Shell", Unit="cm")
loadcase = CreateLoadCase(CaseID="1", Name="DL", Type="Dead")
duppt_3 = RemoveDuplicatePts(Points=explode_3.Vertices, Tolerance=0.01)
loadcase_2 = CreateLoadCase(CaseID="1", Name="DL", Type="Dead")
reduce = RandomReduce(List=demesh.Vertices, Reduction=subtraction, Seed=1)
prop2d_3 = Create2DProperty(Thickness_cm="2", Material=mat_3, Type="Shell", Unit="cm")
explode_4 = Explode(Curve=item_3, Recursive=True)  # -> Segments, Vertices
support = CreateSupport(Point=duppt, Plane=PlaneXY(0, 0, 0), x=True, xx=False, y=True, yy=False, z=True, zz=False)
loadcase_3 = CreateLoadCase(CaseID="1", Name="DL", Type="Dead")
medges_2 = MeshEdges(Mesh=mesh)  # -> NakedEdges, InteriorEdges, NonManifoldEdges
support_2 = CreateSupport(Point=duppt_2, Plane=PlaneXY(0, 0, 0), x=True, xx=True, y=True, yy=True, z=True, zz=True)
lng_2 = ListLength(List=explode_4.Vertices)
medges_3 = MeshEdges(Mesh=mesh_uv_4)  # -> NakedEdges, InteriorEdges, NonManifoldEdges
σa = CreateAnalysisCase(Name="LC1", Description="LC1")
support_3 = CreateSupport(Point=duppt_3, Plane=PlaneXY(0, 0, 0), x=True, xx=False, y=True, yy=False, z=True, zz=False)
elem2d = Create2DElement(Geometry=mesh_uv, Property2D=prop2d, Preview3dSection=False)
division = Division(A=lng_2, B=2)
elem2d_2 = Create2DElement(Geometry=mesh_uv_2, Property2D=prop2d_2, Preview3dSection=False)
join_2 = JoinCurves(Curves=medges_2.NakedEdges, Preserve=False)
join_3 = JoinCurves(Curves=medges_3.NakedEdges, Preserve=False)
faceload = CreateFaceLoad(
    LoadCase=loadcase,
    Loadable2DObjects=elem2d,
    Axis=-1,
    Direction="z",
    Projected=False,
    Value_kN_m²="-1",
    Type="Uniform",
    Unit="kN/m²")
σt = CreateAnalysisTask(Name="LC1", casesParamIndex=2, Solver="Static")
elem2d_3 = Create2DElement(Geometry=mesh_uv_3, Property2D=prop2d_3, Preview3dSection=False)
round = Round(Number=division)  # -> Nearest, Floor, Ceiling
σt_2 = CreateAnalysisTask(AnalysisCases=σa, casesParamIndex=2, Solver="Static")
splitatcorners_2 = SplitAtCorners(Poly=join_2, Angle=Slider(0.785, range=0..1))  # -> Corners, Parts
splitatcorners_3 = SplitAtCorners(Poly=join_3, Angle=Slider(0.785, range=0..1))  # -> Corners, Parts
faceload_2 = CreateFaceLoad(
    LoadCase=loadcase_3,
    Loadable2DObjects=elem2d_3,
    Axis=-1,
    Direction="z",
    Projected=False,
    Value_kN_m²="-1",
    Type="Uniform",
    Unit="kN/m²")
σt_3 = CreateAnalysisTask(casesParamIndex=2, Solver="Static")
item_4 = ListItem(List=splitatcorners_3.Parts, Index=[0, 2], Wrap=True)
item_5 = ListItem(List=explode_4.Vertices, Index=round.Ceiling, Wrap=True)
mat_4 = CreateMaterial(Material_type="Steel", Design_Code="EN 1993-1-1:2005", Grade="S355")
mat_5 = CreateMaterial(Material_type="Steel", Design_Code="EN 1993-1-1:2005", Grade="S355")
nodeload = CreateNodeLoad(LoadCase=loadcase_2, NodeList=item_5, Direction="z", Value_kN="-1", Type="NodeForce", Unit="kN")
explode_5 = Explode(Curve=splitatcorners_2.Parts, Recursive=True)  # -> Segments, Vertices
explode_6 = Explode(Curve=item_4, Recursive=True)  # -> Segments, Vertices
duppt_4 = RemoveDuplicatePts(Points=flatten(explode_5.Vertices), Tolerance=0.01)
model = CreateModel(
    GSAGeometryIn_m=flatten([support, elem2d]),
    Load=faceload,
    AnalysisTasksCombinations=σt,
    ReMesh=True,
    Tolerance=0.01,
    Unit="m")
loadcase_4 = CreateLoadCase(CaseID="1", Name="DL", Type="Dead")
loadcase_5 = CreateLoadCase(CaseID="1", Name="DL", Type="Dead")
model_2 = CreateModel(
    GSAGeometryIn_m=flatten([support_2, elem2d_2]),
    Load=nodeload,
    AnalysisTasksCombinations=σt_2,
    ReMesh=True,
    Tolerance=0.01,
    Unit="m")
duppt_5 = RemoveDuplicatePts(Points=explode_6.Vertices, Tolerance=0.01)
prop2d_4 = Create2DProperty(Thickness_cm="2", Material=mat_4, Type="Shell", Unit="cm")
prop2d_5 = Create2DProperty(Thickness_cm="2", Material=mat_5, Type="Shell", Unit="cm")
model_3 = CreateModel(
    GSAGeometryIn_m=flatten([support_3, elem2d_3]),
    Load=faceload_2,
    AnalysisTasksCombinations=σt_3,
    ReMesh=True,
    Tolerance=0.01,
    Unit="m")
support_4 = CreateSupport(Point=duppt_4, Plane=PlaneXY(0, 0, 0), x=True, xx=False, y=True, yy=False, z=True, zz=False)
support_5 = CreateSupport(Point=duppt_5, Plane=PlaneXY(0, 0, 0), x=True, xx=False, y=True, yy=False, z=True, zz=False)
σa_2 = CreateAnalysisCase(Name="L1", Description="L1")
σa_3 = CreateAnalysisCase(Name="L1", Description="L1")
elem2d_4 = Create2DElement(Geometry=mesh, Property2D=prop2d_4, Preview3dSection=False)
elem2d_5 = Create2DElement(Geometry=mesh_uv_4, Property2D=prop2d_5, Preview3dSection=False)
panel_3 = Panel("C:\Users\Matt C\Documents\GitHub\PrincipalStressLines\Example Files\GSA  Model.gwb")
loadcase_6 = CreateLoadCase(CaseID="1", Name="DL", Type="Dead")
save = Button()
σt_4 = CreateAnalysisTask(AnalysisCases=σa_2, casesParamIndex=2, Solver="Static")
σt_5 = CreateAnalysisTask(AnalysisCases=σa_3, casesParamIndex=2, Solver="Static")
nodeload_2 = CreateNodeLoad(LoadCase=loadcase_4, NodeList=reduce, Direction="z", Value_kN="-1", Type="NodeForce", Unit="kN")
nodeload_3 = CreateNodeLoad(LoadCase=loadcase_5, NodeList=cps_2.ClosestPoint, Direction="z", Value_kN="-1", Type="NodeForce", Unit="kN")
save_2 = SaveGSAModel(GSAModel=model_2, Save=save, FileAndPath=panel_3)
faceload_3 = CreateFaceLoad(
    LoadCase=loadcase_6,
    Loadable2DObjects=elem2d_5,
    Axis=-1,
    Direction="z",
    Projected=False,
    Value_kN_m²="-1",
    Type="Uniform",
    Unit="kN/m²")
panel_4 = Panel("C:\Users\4Matt\Documents\GitHub\PrincipalStressLines\Example Files\Model.gwb")
save_3 = Button()
model_4 = CreateModel(
    GSAGeometryIn_m=flatten([support_4, elem2d_4]),
    Load=nodeload_2,
    AnalysisTasksCombinations=σt_4,
    ReMesh=True,
    Tolerance=0.01,
    Unit="m")
model_5 = CreateModel(
    GSAGeometryIn_m=flatten([support_5, elem2d_5]),
    Load=nodeload_3,
    AnalysisTasksCombinations=σt_5,
    ReMesh=True,
    Tolerance=0.01,
    Unit="m")
save_4 = SaveGSAModel(GSAModel=model, Save=save_3, FileAndPath=panel_4)
panel_5 = Panel("C:\Users\4Matt\Documents\GitHub\PrincipalStressLines\Example Files\Spherical Shell1.gwb")
panel_6 = Panel("C:\Users\4Matt\Documents\GitHub\PrincipalStressLines\Example Files\Cylindrical Shell.gwb")
save_5 = Button()
save_6 = Button()
save_7 = SaveGSAModel(GSAModel=model_4, Save=save_5, FileAndPath=panel_5)
save_8 = SaveGSAModel(GSAModel=model_5, Save=save_6, FileAndPath=panel_6)
