# Grasshopper definition LilyPad_Simple Intro.gh (Grasshopper 1.0.8)
# plug-ins: MeshEdit Components, treesloth01, Human, Kangaroo Components, RichedGraphMapper, Weaverbird, LilyPad

# ---- group: Step 1: Create Geometry
rectangle = Rectangle(Plane=PlaneXY(0, 0, 0), XSize="-2 to 2", YSize="-2 to 2", Radius=0)  # -> Rectangle, Length
mplane = MeshPlane(Boundary=rectangle.Rectangle, WidthCount="4", HeightCount="4")  # -> Mesh, Area
mesh = Mesh(mplane.Mesh)
preview = CustomPreview(Geometry=mesh, Material=ColourSwatch(SwatchColor=RGB(217, 217, 217)))

# ----
mplane_2 = MeshPlane(Boundary=rectangle.Rectangle, WidthCount="2", HeightCount="2")  # -> Mesh, Area
mesh_2 = Mesh(graft(mplane_2.Mesh))

tri = Triangulate(Mesh=mplane_2.Mesh)  # -> Mesh, Count
nv = NakedVertices(Mesh=graft(tri.Mesh))  # -> ClothedIndex, NakedIndex, ClothedPts, NakedPts
wbfacepolys = WeaverbirdsFacePolylines(Mesh=tri.Mesh)
nv_2 = NakedVertices(Mesh=mesh)  # -> ClothedIndex, NakedIndex, ClothedPts, NakedPts
disc = Discontinuity(Curve=wbfacepolys, Level=1)  # -> Points, Parameters
avr = Average(Input=disc.Points)
relay = Relay([nv_2.ClothedPts, nv_2.NakedPts])
cir = Circle(Plane=avr, Radius=1)
alongcrv = SortAlongCurve(Points=simplify(disc.Points), Curve=cir)  # -> simplify(Points), Indices
cp = ClosestPoint(Point=graft(alongcrv.Points), Cloud=relay)  # -> ClosestPoint, CPIndex, Distance
shift = ShiftPaths(Data=cp.CPIndex, Offset=-1)
item = ListItem(List=shift, Index=0, Wrap=True)  # -> Item, Item1, Item2
triangle = MeshTriangle(CornerA=item.Item, CornerB=item.Item1, CornerC=item.Item2)
conmesh = ConstructMesh(Vertices=flatten(relay), Faces=flatten(triangle))

explode = MeshExplode(Mesh=mesh_2, Interpolate=False)
clean = CombineClean(Meshes=tri.Mesh)
wbfacepolys_2 = WeaverbirdsFacePolylines(Mesh=explode)
disc_2 = Discontinuity(Curve=wbfacepolys_2, Level=1)  # -> Points, Parameters
area = Area(Geometry=wbfacepolys_2)  # -> Area, Centroid
shatter = Shatter(Curve=wbfacepolys_2, Parameters=disc_2.Parameters)
midpt = CurveMiddle(Curve=shatter)
merge = Merge(Data1=disc_2.Points, Data2=midpt)  # -> simplify(Result)
clean_2 = CombineClean(Meshes=mesh)
duppt = RemoveDuplicatePts(Points=flatten(merge), Tolerance=0.01)

avr_2 = Average(Input=area.Centroid)
cir_2 = Circle(Plane=avr_2, Radius=0.1)
alongcrv_2 = SortAlongCurve(Points=simplify(disc_2.Points), Curve=cir_2)  # -> simplify(Points), Indices
cp_2 = ClosestPoint(Point=alongcrv_2.Points, Cloud=duppt)  # -> ClosestPoint, CPIndex, Distance
item_2 = ListItem(List=cp_2.CPIndex, Index=0, Wrap=True)  # -> Item, Item1, Item2, Item3
quad = MeshQuad(CornerA=item_2.Item, CornerB=item_2.Item1, CornerC=item_2.Item2, CornerD=item_2.Item3)
conmesh_2 = ConstructMesh(Vertices=flatten(duppt), Faces=flatten(quad))

tri_2 = Triangulate(Mesh=clean_2)  # -> Mesh, Count
panel = Panel(clean_2)
panel_2 = Panel(tri_2.Mesh)
shift_2 = ShiftPaths(Data=cp_2.CPIndex, Offset=-1)
panel_3 = Panel(conmesh_2)

demesh = DeconstructMesh(Mesh=conmesh)  # -> Vertices, Faces, Colours, Normals
lng = ListLength(List=demesh.Vertices)
series = Series(Start=0, Step=1, Count=lng)
avr_3 = Average(Input=demesh.Vertices)
dist = Distance(PointA=avr_3, PointB=demesh.Vertices)
bnd = Bounds(Numbers=series)
dom = ConstructDomain(DomainStart=Slider(0, range=0..100), DomainEnd=Slider(1, range=0..3))
rich_graph = RichGraphMapper(
    Values=series,
    Source=bnd,
    Target=dom,
    Remap=False,
    x0=0,
    x1=24,
    y0=0,
    y1=1,
    container_name="Sine",
    Equation_px=[0, 0.07166486233],
    Equation_py=[0, 1])
neg = Negative(Value=rich_graph)
pt = ConstructPoint(XCoordinate=0, YCoordinate=0, ZCoordinate=rich_graph)
move = Move(Geometry=demesh.Vertices, Motion=pt)  # -> Geometry, Transform
conmesh_3 = ConstructMesh(Vertices=move.Geometry, Faces=demesh.Faces)

# ---- group: Step 3.0: Input Mesh Topo Check
wbfacepolys_3 = WeaverbirdsFacePolylines(Mesh=conmesh)
demesh_2 = DeconstructMesh(Mesh=conmesh)  # -> Vertices, Faces, Colours, Normals
deface = DeconstructFace(Face=graft(demesh_2.Faces))  # -> CornerA, CornerB, CornerC, CornerD
merge_2 = Merge(Data1=deface.CornerA, Data2=deface.CornerB, Data3=deface.CornerC, Data4=deface.CornerD)  # -> simplify(Result)
tstat = TreeStatistics(Tree=merge_2)  # -> Paths, Length, Count
item_3 = ListItem(List=tstat.Paths, Index=0, Wrap=True)
split = SplitTree(Data=merge_2, Masks=flatten(item_3))  # -> Positive, Negative
cset = CreateSet(List=split.Positive)  # -> Set, Map
item_4 = ListItem(List=demesh_2.Vertices, Index=cset.Set, Wrap=True)
points = PointList(Points=demesh_2.Vertices, Size=Slider(0.5, range=0..1))
previewlw = CustomPreviewLineweights(Geometry=wbfacepolys_3, Shader=ColourSwatch(SwatchColor=RGB(0, 0, 0)), Thickness=4, Absolute=False)

# ----
demesh_3 = DeconstructMesh(Mesh=conmesh)  # -> simplify(Vertices), Faces, Colours, Normals
Z = UnitZ(Factor=1)
line = LineSDL(Start=demesh_3.Vertices, Direction=Z, Length=1)
mcx = MeshCurve(Mesh=conmesh_3, Curve=line)  # -> simplify(Points), Faces
shift_3 = ShiftPaths(Data=mcx.Points, Offset=-1)
vec2pt = Vector2Pt(PointA=demesh_3.Vertices, PointB=shift_3, Unitize=False)  # -> Vector, Length

# ---- group: Step 3.1: Create Deformation Mesh(Generating vector fields)
# Create Principle Mesh
panel_4 = Panel("""True - Bending Stress Lines
False - In-plane Stress Lines""")
list = ItemSelector(panel_4, {"True - Bending Stress Lines", "False - In-plane Stress Lines"}, selected="False - In-plane Stress Lines")
rotations = Relay()
cluster = Cluster(T=list)
panel_5 = Panel("0.3")

# Create Principle Mesh
panel_6 = Panel("""True - Bending Stress Lines
False - In-plane Stress Lines""")
list_2 = ItemSelector(panel_6, {"True - Bending Stress Lines", "False - In-plane Stress Lines"}, selected="False - In-plane Stress Lines")  # disabled
rotations_2 = Relay()  # disabled
panel_7 = Panel("0.3")  # disabled
cluster_2 = Cluster(T=list_2)  # disabled
facen = FaceNormals(Mesh=conmesh)  # -> Centers, Normals; disabled
defmesh = CreateDeformationMesh(Mesh=conmesh, Translations=pt, Rotations=rotations_2, PoissonsRatio=panel_7, BendingStressLines=cluster_2)  # -> PrincipalDirection1, PrincipalDirection2; disabled
# Note On Vector Field Generation: Principle Vector Field(P1/P2) is generated for either Bending stress lines or In-plane stress lines
# Bending stress lines - rotational input is required - i.e.slab structure/dome structure
# In-plane stress lines - translational input is required - i.e.shear wall structure
eval = EvaluatePrincipalMesh(Principal=defmesh.PrincipalDirection2, Location=facen.Centers)  # disabled
eval_2 = EvaluatePrincipalMesh(Principal=defmesh.PrincipalDirection1, Location=facen.Centers)  # disabled
vdisex = VectorDisplayEx(Point=facen.Centers, Vector=expr("x/10", eval), Colour=RGB(255, 143, 212), Width=2)  # disabled
vdisex_2 = VectorDisplayEx(Point=facen.Centers, Vector=expr("x/10", eval_2), Colour=RGB(82, 184, 59), Width=2)  # disabled

# ----
facen_2 = FaceNormals(Mesh=conmesh)  # -> Centers, Normals
defmeshhigh = CreateDeformationMeshHigher(Mesh=conmesh, Translations=pt, Rotations=Vector(0, 0, 0), PoissonsRatio=panel_5, BendingStressLines=cluster)  # -> PrincipalDirection1, PrincipalDirection2
defmeshhigh_2 = CreateDeformationMeshHigher(Mesh=conmesh, Translations=pt, Rotations=Vector(0, 0, 0), PoissonsRatio=0, BendingStressLines=cluster_2)  # -> PrincipalDirection1, PrincipalDirection2; disabled
eval_3 = EvaluatePrincipalMesh(Principal=defmeshhigh.PrincipalDirection1, Location=facen_2.Centers)
eval_4 = EvaluatePrincipalMesh(Principal=defmeshhigh.PrincipalDirection2, Location=facen_2.Centers)
vdisex_3 = VectorDisplayEx(Point=facen_2.Centers, Vector=expr("x/10", eval_3), Colour=RGB(255, 143, 212), Width=2)

# ---- group: Vector Field
# Input the principle stress fields that is avaliable
v1 = Data(eval_3)  # disabled
v2 = Data(eval_4)  # disabled

# ---- group: Step 3.2: Vector Mesh (Smoothing vectors for stressline generation)
# Smoothing Radius: Refine vector to be the average vectors within the radius distance
smoothing_radius = Panel("0.5")  # disabled
vectormesh = CreateVectorMesh(Mesh=conmesh, Vectors1st=v1, Vectors2nd=v2, Radius=smoothing_radius)  # -> PrincipleDirection1, PrincipleDirection2; disabled

# ----
wbvertices = WeaverbirdsVerticesComponent(MeshClosedPolylinesGroup=conmesh, Weld=True)

# ---- group: Step 4: Selecting Seed Point
md_slider = MDSlider(SliderMode=0, slider_value=Point(1, 1, 0.5), x_domain=Domain(0, 1), y_domain=Domain(0.5, 1), z_domain=Domain(0, 1))  # disabled
srf = Surface(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)  # disabled
evalsrf = EvaluateSurface(Surface=reparameterize(srf), Point=md_slider)  # -> Point, Normal, UDirection, VDirection, Frame; disabled
meshcp = MeshClosestPoint(Point=evalsrf.Point, Mesh=conmesh)  # -> Point, Index, Parameter; disabled

# ----
item_5 = ListItem(List=wbvertices, Index=Slider(5, range=0..10), Wrap=True)
sph = Sphere(Base=meshcp.Point, Radius=smoothing_radius)  # disabled

# ---- group: Step 5: Create Evenly Spaced Stress Lines
# Evenly Spaced Stress Lines
number_slider = Slider(-5, range=-10..0)  # disabled
number_slider_2 = Slider(0.1, range=0..1)  # disabled
number_slider_3 = Slider(0.5, range=0..1)  # disabled
number_slider_4 = Slider(0.05, range=0..0.1)  # disabled
_10º = PowerOf10(Value=number_slider)  # disabled
number_slider_5 = Slider(5, range=1..5)  # disabled
sls = StressLines(
    PrincipalMesh=vectormesh.PrincipleDirection2,
    Seed=meshcp.Point,
    StepTolerance=number_slider_2,
    MaxError=_10º,
    Seperation=number_slider_3,
    TestDist=number_slider_4)  # disabled
sls_2 = StressLines(
    PrincipalMesh=vectormesh.PrincipleDirection1,
    Seed=meshcp.Point,
    StepTolerance=number_slider_2,
    MaxError=_10º,
    Seperation=number_slider_3,
    TestDist=number_slider_4)  # disabled
swatch = ColourSwatch(SwatchColor=RGB(82, 184, 59))  # disabled
swatch_2 = ColourSwatch(SwatchColor=RGB(255, 143, 212))  # disabled
previewlw_2 = CustomPreviewLineweights(Geometry=sls_2, Shader=swatch, Thickness=number_slider_5, Absolute=False)  # disabled
previewlw_3 = CustomPreviewLineweights(Geometry=sls, Shader=swatch_2, Thickness=number_slider_5, Absolute=False)  # disabled

# ---- group: Step 5: Create A Stressline_P1
# Single Stress Line
number_slider_6 = Slider(-4, range=-10..0)  # disabled
panel_8 = Panel("0.2")  # disabled
_10º_2 = PowerOf10(Value=number_slider_6)  # disabled
stress_line = StressLine(PrincipalMesh=vectormesh.PrincipleDirection1, Seed=meshcp.Point, StepTolerance=panel_8, MaxError=_10º_2)  # disabled
stress_line_2 = StressLine(PrincipalMesh=vectormesh.PrincipleDirection2, Seed=meshcp.Point, StepTolerance=panel_8, MaxError=_10º_2)  # disabled
preview_2 = CustomPreview(
    Geometry=stress_line,
    Material={diffuse=RGB(13, 201, 0), emission=RGB(4, 60, 0), shine=0.5, specular=RGB(255, 255, 255), transparency=0})  # disabled
preview_3 = CustomPreview(
    Geometry=stress_line_2,
    Material={diffuse=RGB(13, 201, 0), emission=RGB(4, 60, 0), shine=0.5, specular=RGB(255, 255, 255), transparency=0})  # disabled

# ---- group: Step 5: Create Evenly Spaced Stress Lines
# Evenly Spaced Stress Lines
number_slider_7 = Slider(-5, range=-10..0)
number_slider_8 = Slider(0.004, range=0..1)
number_slider_9 = Slider(2, range=0..10)
number_slider_10 = Slider(0.01, range=0..0.1)
_10º_3 = PowerOf10(Value=number_slider_7)
number_slider_11 = Slider(5, range=1..5)
sls_3 = StressLines(
    PrincipalMesh=defmeshhigh.PrincipalDirection2,
    Seed=item_5,
    StepTolerance=number_slider_8,
    MaxError=_10º_3,
    Seperation=number_slider_9,
    TestDist=number_slider_10)
sls_4 = StressLines(
    PrincipalMesh=defmeshhigh.PrincipalDirection1,
    Seed=item_5,
    StepTolerance=number_slider_8,
    MaxError=_10º_3,
    Seperation=number_slider_9,
    TestDist=number_slider_10)
previewlw_4 = CustomPreviewLineweights(Geometry=sls_4, Shader=ColourSwatch(SwatchColor=RGB(82, 184, 59)), Thickness=number_slider_11, Absolute=False)
previewlw_5 = CustomPreviewLineweights(Geometry=sls_3, Shader=ColourSwatch(SwatchColor=RGB(255, 143, 212)), Thickness=number_slider_11, Absolute=False)

# ---- group: Step 5: Create A Stressline_P1
# Single Stress Line
number_slider_12 = Slider(-5, range=-10..0)
_10º_4 = PowerOf10(Value=number_slider_12)
stress_line_3 = StressLine(PrincipalMesh=defmeshhigh.PrincipalDirection1, Seed=item_5, StepTolerance="0.1", MaxError=_10º_4)
stress_line_4 = StressLine(PrincipalMesh=defmeshhigh.PrincipalDirection2, Seed=item_5, StepTolerance="0.1", MaxError=_10º_4)
preview_4 = CustomPreview(
    Geometry=stress_line_3,
    Material={diffuse=RGB(13, 201, 0), emission=RGB(4, 60, 0), shine=0.5, specular=RGB(255, 255, 255), transparency=0})
preview_5 = CustomPreview(
    Geometry=stress_line_4,
    Material={diffuse=RGB(13, 201, 0), emission=RGB(4, 60, 0), shine=0.5, specular=RGB(255, 255, 255), transparency=0})

# ---- group: Step 5: Evaluate Principle Mesh
# Vectors
eval_5 = EvaluatePrincipalMesh(Principal=vectormesh.PrincipleDirection2, Location=meshcp.Point)  # disabled
# Results
eval_6 = EvaluatePrincipalMesh(Principal=vectormesh.PrincipleDirection1, Location=meshcp.Point)  # disabled
vdisex_4 = VectorDisplayEx(Point=meshcp.Point, Vector=eval_5, Colour=RGB(255, 143, 212), Width=2)  # disabled
vdisex_5 = VectorDisplayEx(Point=meshcp.Point, Vector=eval_6, Colour=RGB(82, 184, 59), Width=2)  # disabled

# Vectors
eval_7 = EvaluatePrincipalMesh(Principal=defmeshhigh.PrincipalDirection2, Location=item_5)
# Results
eval_8 = EvaluatePrincipalMesh(Principal=defmeshhigh.PrincipalDirection1, Location=item_5)
vdisex_6 = VectorDisplayEx(Point=item_5, Vector=eval_7, Colour=RGB(255, 143, 212), Width=2)
vdisex_7 = VectorDisplayEx(Point=item_5, Vector=eval_8, Colour=RGB(82, 184, 59), Width=2)

# ==== cluster Cluster
T = ClusterInput()
split = TextSplit(Text=T, Separators=" - ")
item = ListItem(List=split, Index=0, Wrap=True)  # -> flatten(Item)
bool = Boolean(item)
bool_2 = ClusterOutput(bool)
